% Simulink data dictionary dict.sldd

Lux_t = Simulink.ValueType(DataType="uint16", Min=0, Max=64000, Unit="lx", be=Simulink.BusElement(Name="a", DataType="double"))  % Lux_t
  % Data Type: uint16
  % Description: Lux_t is a custom data type used to represent light intensity measurements in lux (lx). This type is designed for scenarios where light levels need to be measured and stored with precision, particularly in automotive and environmental sensing applications.
  % Range: 0 to 64,000 lux.
  % 0 lux represents complete darkness.
  % 64,000 lux represents the maximum measurable light intensity for this data type.
  % Resolution: This type can accurately represent light levels with a granularity of 1 lux. For finer resolution, such as 0.1 lux, you may need to scale the values accordingly (e.g., storing values multiplied by 10).

TurnSignal_t = Simulink.ValueType(DataType="uint8", Min=0, Max=2, be=Simulink.BusElement(Name="a", DataType="double"))  % User command for Turn signals values:
  % 0: No lights
  % 1: Right signals
  % 2: Left signals

HighBeam_Cmd = Simulink.Bus()
  Value: boolean, Min=0, Max=1  % User command for high Beam activation
    % 0: OFF
    % 1: ON

TurnSignal_Cmd = Simulink.Bus()
  Value: ValueType: TurnSignal_t

Humidity_Data = Simulink.Bus()
  Value: ValueType: Humidity_t

Ignition_State = Simulink.Bus()
  Value: boolean, Min=0, Max=1  % Ignition State:
    % 0: OFF
    % 1: ON

Light_Data = Simulink.Bus()
  Value: ValueType: Lux_t

Visibility_Distance = Simulink.Bus()
  Value: ValueType: Visibility_t

Sensor_to_Ctrl = Simulink.Bus()
  Value: boolean, Min=0, Max=1  % Sensors detection output values:
    % 0: nothing detected
    % 1: night or fog detected

Architecture_Out = Simulink.Bus()
  Value: boolean, Min=0, Max=1  % Lights state On or OFF (LowBeam, HighBeam, DRL, FogLight, ...):
    % 0: Light should be OFF
    % 1: Light should be ON

Ctrl_to_Act = Simulink.Bus()
  Value: boolean  % Lights state On or OFF (LowBeam, HighBeam, DRL, FogLight, ...):
    % 0: Light should be OFF
    % 1: Light should be ON

Final_Out = Simulink.Bus()
  Value: boolean

Dem_EventStatusType = enum(HeaderFile="Rte_Type.h", DefaultValue="DEM_EVENT_STATUS_PASSED", StorageType="uint8")
  DEM_EVENT_STATUS_PASSED = 0
  DEM_EVENT_STATUS_FAILED = 1
  DEM_EVENT_STATUS_PREPASSED = 2
  DEM_EVENT_STATUS_PREFAILED = 3
  DEM_EVENT_STATUS_FDC_THRESHOLD_REACHED = 4

Dem_DTCFormatType = enum(HeaderFile="Rte_Type.h", DefaultValue="DEM_DTC_FORMAT_OBD", StorageType="uint8")
  DEM_DTC_FORMAT_OBD = 0
  DEM_DTC_FORMAT_UDS = 1

Dem_OperationCycleStateType = enum(HeaderFile="Rte_Type.h", DefaultValue="DEM_CYCLE_STATE_START", StorageType="uint8")
  DEM_CYCLE_STATE_START = 0
  DEM_CYCLE_STATE_END = 1

Dem_DebouncingStateType = enum(HeaderFile="Rte_Type.h", DefaultValue="DEM_TEMPORARILY_DEFECTIVE", StorageType="uint8")
  DEM_TEMPORARILY_DEFECTIVE = 1
  DEM_FINALLY_DETECTIVE = 2
  DEM_TEMPORARILY_HEALED = 4
  DEM_TEST_COMPLETE = 8
  DEM_DTR_UPDATE = 16

Dem_IumprDenomCondStatusType = enum(HeaderFile="Rte_Type.h", DefaultValue="DEM_IUMPR_DEN_STATUS_NOT_REACHED", StorageType="uint8")
  DEM_IUMPR_DEN_STATUS_NOT_REACHED = 0
  DEM_IUMPR_DEN_STATUS_REACHED = 1
  DEM_IUMPR_DEN_STATUS_INHIBITED = 2

Dem_DTRControlType = enum(HeaderFile="Rte_Type.h", DefaultValue="DEM_DTR_CTL_NORMAL", StorageType="uint8")
  DEM_DTR_CTL_NORMAL = 0
  DEM_DTR_CTL_NO_MAX = 1
  DEM_DTR_CTL_NO_MIN = 2
  DEM_DTR_CTL_RESET = 3
  DEM_DTR_CTL_INVISIBLE = 4

Dem_IndicatorStatusType = enum(HeaderFile="Rte_Type.h", DefaultValue="DEM_INDICATOR_OFF", StorageType="uint8")
  DEM_INDICATOR_OFF = 0
  DEM_INDICATOR_CONTINUOUS = 1
  DEM_INDICATOR_BLINKING = 2
  DEM_INDICATOR_BLINK_CONT = 3
  DEM_INDICATOR_SLOW_FLASH = 4
  DEM_INDICATOR_FAST_FLASH = 5
  DEM_INDICATOR_ON_DEMAND = 6
  DEM_INDICATOR_SHORT = 7

NvM_RamBlockStatusType = enum(DefaultValue="NVM_RAMBLOCK_STATUS_UNITIALIZED", StorageType="uint8")
  NVM_RAMBLOCK_STATUS_UNITIALIZED = 0
  NVM_RAMBLOCK_STATUS_INVALID_UNCHANGED = 1
  NVM_RAMBLOCK_STATUS_VALID_CHANGED = 2
  NVM_RAMBLOCK_STATUS_VALID_UNCHANGED = 3

NvM_RequestResultType = enum(DefaultValue="NVM_REQ_OK", StorageType="uint8")
  NVM_REQ_OK = 0
  NVM_REQ_NOT_OK = 1
  NVM_REQ_PENDING = 2
  NVM_REQ_INTEGRITY_FAILED = 3
  NVM_REQ_BLOCK_SKIPPED = 4
  NVM_REQ_NV_INVALIDATED = 5
  NVM_REQ_CANCELED = 6
  NVM_REQ_REDUNDANCY_FAILED = 7
  NVM_REQ_RESTORED_FROM_ROM = 8

Visibility_t = Simulink.ValueType(DataType="uint16", Min=0, Max=300, Unit="meter", be=Simulink.BusElement(Name="a", DataType="double"))  % Visibility_t
  % Data Type: uint16
  % Description: Visibility_t is a custom data type used to represent visibility measurements in automotive and environmental applications. It quantifies visibility conditions, such as the distance a vehicle can see or the clarity of the environment, based on sensor data. This type helps in interpreting and utilizing visibility information to enhance safety and system performance.
  % Range: 0 to 100
  % 0: Represents minimal or no visibility.
  % 100: Represents the maximum visibility level the sensor can measure.
  % Units: meter

Humidity_t = Simulink.ValueType(DataType="uint8", Min=0, Max=100, Unit="%RH", be=Simulink.BusElement(Name="a", DataType="double"))  % Humidity_t
  % Data Type: uint8
  % Description: Humidity_t is a custom data type used to represent relative humidity (RH) in automotive applications. This type stores humidity values ranging from 0% to 100% RH with a resolution of 1% RH. The value is scaled by a factor of 10, so each unit of Humidity_t represents 1% RH.
  % Range: 0 to 100, where:
  % 0 represents 0% RH (completely dry air).
  % 100 represents 100% RH (fully saturated air).
  % Resolution: Each increment represents 1% RH, providing high precision in humidity measurements.

Inter_Comp = Simulink.Bus()
  Value: boolean